# Grasshopper definition 2G-GumballInput_Tutorial1.ghx (Grasshopper 1.0.7)
# plug-ins: ShapeDiverForGrasshopper, Pufferfish, GrasshopperHyperGooComponents

# ----
# This example model describes the minimal setup to make a single object in the ShapeDiver viewer transformable using a Gumball.
# 
# Important points to pay attention to:
# * Use a named glTF 2.0 Display component
# * Inject a name attribute in the object
# * Match the name filter of the Gumball to the component and object's name.
# * Test the presence of a transformation and send the Identity if none are present.
# * Do not apply the transformation directly, but instead store it as an attribute.
# Filter transformable objects: Use the Name filters option to specify which objects should be selectable.
# 
# In our example, we define a single object using the name of the component followed by the name attribute of the object in a dot-separated notation:
# "MyDisplayComponent.box".
# Component output: Once online, the component returns the name of the transformed object(s) in the viewer, if there are any.
# 
# Use the Local Test Data option to test locally your definition.
# 
# In our example, we specify "MyDisplayComponent.box" to simulate that the object was transformed in the viewer.
gumballinput = GumballInput(
    EnableTranslationAxes_X=True,
    EnableTranslationAxes_Y=True,
    EnableTranslationAxes_Z=True,
    EnableRotationAxes_X=True,
    EnableRotationAxes_Y=True,
    EnableRotationAxes_Z=True,
    EnableScalingAxes_X=False,
    EnableScalingAxes_Y=False,
    EnableScalingAxes_Z=False,
    NameFilters_Branch0_Path="{0}",
    NameFilters_Branch0_Item0_null_string=False,
    NameFilters_Branch0_Item0_string="MyDisplayComponent.box",
    LocalTestData_Branch0_Path="{0}",
    LocalTestData_Branch0_Item0_null_string=False,
    LocalTestData_Branch0_Item0_string="MyDisplayComponent.box")  # -> Names, Transforms

# ----
# Test the input transformation: In case it is empty, send the Identity transformation.
zerotran = ZeroedTransform()
null = NullItem(Item=gumballinput.Transforms)  # -> NullFlags, InvalidFlags, Description
filter = StreamFilter(Gate=null.NullFlags, Stream0=gumballinput.Transforms, Stream1=zerotran)
transform = Transform(filter)

mesh = Mesh(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)

mesh_2 = Mesh(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)
mesh_3 = Mesh(mesh)
transform_2 = Transform(transform)
transform_3 = Transform(Geometry=mesh_3, Transform=transform_2)
volume = Volume(Geometry=transform_3)  # -> Volume, Centroid
scale = Scale(Geometry=transform_3, Center=volume.Centroid, Factor="1.5")  # -> Geometry, Transform
mdif = MeshDifference(MeshesA=mesh_2, MeshesB=scale.Geometry)
gltfdisplay = GlTF20Display(Geometry=mdif, Material=ColourSwatch(SwatchColor=RGB(229, 112, 255)))

# ----
# Give each object a name: Use the ShapeDiver Attribute system to store a name attribute in each object you want to make selectable.
# 
# The Gumball Input then allows to specify which objects are transformable using their names.
# Apply the transformations: In order to communicate with the App, the transformable objects should not be transformed directly in Grasshopper. Instead, one must attach the transformation as an attribute.
mesh_4 = Mesh(mesh)
merge = Merge(Data1="name", Data2="transform")
merge_2 = Merge(Data1="box", Data2=transform)

constructattr = ConstructAttributes(Keys=merge, Values=merge_2)

injectattr = InjectAttributes(Object=mesh_4, Attributes=constructattr)

panel = Panel(injectattr)

# ----
# Use glTF 2.0 Display components: Transformable objects need to be part of a glTF 2.0 Display component.
# 
# The name of the component is also important, as there might be several such components in the definition! The Gumball Input uses a dot-separated name for filtering objects: DISPLAY_COMPONENT_NAME.OBJECT_NAME
# Example: In our example, the name of the Display component is "MyDisplayComponent", and the object inside it is called "box".
mydisplaycomponent = GlTF20Display(Geometry=injectattr, Material=ColourSwatch(SwatchColor=RGB(79, 255, 105)))
