# Grasshopper definition 8A-SpecklePublish.ghx (Grasshopper 1.0.7)
# plug-ins: ShapeDiverForGrasshopper, Speckle.Connector.Grasshopper, GrasshopperHyperGooComponents

# Use the synchronous Load and Publish components from the Dev category!
# This model requires a personal access token for your Speckle account.
# How to create one: https://speckle.guide/dev/tokens.html
# 
# The folllowing scopes are required:
# "profile:read", "streams:read", "streams:write"
# 
# WARNING: Storing your token in a Grasshopper file, or importing it
# using a ShapeDiver Text input, is not good practice for security.
# 
# We recommend to store API keys and passwords in your ShapeDiver account
# and using the ShapeDiver Secret input to retrieve them in your definitions.
speckle_model_url = DirectTextInput(maxlength=10000)
secretinput = SecretInput(SecretName="speckle-token")  # disabled
speckle_token = DirectTextInput(maxlength=10000)

# ---- group: File
# File import
import_from_url = DirectTextInput(maxlength=10000)
import_from_file = ImportGeometry(
    URI=import_from_url,
    maximum_file_size=52428800,
    selected_file_formats="application/3dm,application/3ds,application/ai,application/amf,application/dgn,application/dwg,application/dxf,application/fbx,application/off,application/pdf,application/ply,application/postscript,application/skp,application/sla,application/slc,application/step,application/vda,application/wavefront-obj,image/svg+xml,model/3mf,model/iges,model/stl")  # -> Object, Material, Filename
geo = Geometry(import_from_file.Object)

# ---- group: Speckle
# Speckle model
# Speckle personal access token.
# Use a ShapeDiver Secret input
# for better security
txt = Text(speckle_token)
txt_2 = Text(speckle_model_url)

# ----
# Convert attributes
geo_2 = Geometry(geo)
extractattr = ExtractAttributes(Object=geo_2)
accesskey = AccessKey(Object=extractattr, Key="layer")
geo_3 = Geometry(geo)
accesskey_2 = AccessKey(Object=extractattr, Key="material")
col = Colour(accesskey_2)
cp = CreateProperties(Layer=accesskey, AlwaysInheritNames=False, CreateEmptyProperties=False)
material = CreateMaterial(Diffuse=col, Specular=RGB(255, 255, 255), Emission=RGB(0, 0, 0), Transparency=0, Shine=0)
sg = SpeckleGeometry(Geometry=geo_3, Material=material, HasApplicationIdParam=False)  # -> SpeckleGeometry, Geometry, Color, Material, Path
so = SpeckleObject(SpeckleObject=sg.SpeckleGeometry, Properties=cp, HasApplicationIdParam=False)  # -> SpeckleObject, Geometries, Name, Properties, Path
cc = CreateCollection(SubCollection1=so.SpeckleObject, AlwaysInheritNames=False)

# ----
# Get Speckle Model URL
# with authentication token
txt_3 = Text(txt_2)
txt_4 = Text(txt)
url = SpeckleModelURL(SpeckleUrl=txt_3, SpeckleToken=txt_4)

# ----
# Display imported geometry
geo_4 = Geometry(geo)
gltfdisplay = GlTF20Display(Geometry=geo_4)

publish = BooleanToggle(False)

# ----
# Synchronous! Publish
sp = SyncPublish(SpeckleModel=url, Collection=cc, Run=publish)  # -> SpeckleModel, VersionID

specklemodelresult = DirectDataOutput(Data=sp.SpeckleModel)
