# Grasshopper definition 11B-AppBuilder_Tutorial2.ghx (Grasshopper 1.0.7)
# plug-ins: ShapeDiverForGrasshopper

# ----
# Main algorithm
# Main algorithm: This simple definition creates a parametric twisted tower from three sliders and an Import Geometry component allowing users to upload a curve defining the floor plan of the tower.
# 
# A glTF 2.0 Display component is used to show geometry in the online App.
# 
# A Download Export component is included to let users export the created geometry to 3dm.
floor_plan = ImportGeometry(
    maximum_file_size=52428800,
    selected_file_formats="application/3dm,application/3ds,application/ai,application/amf,application/dgn,application/dwg,application/dxf,application/fbx,application/off,application/pdf,application/ply,application/postscript,application/skp,application/sla,application/slc,application/step,application/vda,application/wavefront-obj,image/svg+xml,model/3mf,model/iges,model/stl")  # -> Object, Material, Filename
rotation_angle = Slider(45, range=0..180)
floor_height = Slider(10, range=5..15)
# App Builder logic
floor_count = Slider(15, range=0..30)
curve = Curve(floor_plan.Object)
cluster = Cluster(curve=curve, num=rotation_angle, num_2=floor_height, int=floor_count)  # -> mesh_3, floorvolume, totalheight
rhino_version = ValueList({"6", "7"}, selected="6")
mesh = Mesh(cluster.mesh_3)
export3dm = _3dmExportOptions(Version=rhino_version)
color = ColourSwatch(SwatchColor=RGB(161, 84, 255))
gltfdisplay = GlTF20Display(Geometry=mesh, Material=color)
num = Number(cluster.floorvolume)
num_2 = Number(cluster.totalheight)
export3dm_2 = DownloadExport(Data=mesh, Options=export3dm, Name="test_export")

# ----
# App Builder Tutorial 2:
# Define parametric logic for the user interface.
# 
# In this app, users are able to upload a file containing a curve defining the tower's floor plan.
# 
# The file upload parameter is always shown in the interface, but we test if a curve exists before showing the other App parameters.
sddb = ShapeDiverDatabase({AbsoluteTolerance=0, AngleTolerance=0, AppDescription="", AppName="rotating-tower-3", DistanceDisplayPrecision=0, DocumentName="rotating-tower-3*", GltfVersion="Gltf1", GrasshopperVersion="1.0.0007", InputGroups="{}", OutputGroups="{}", RelativeTolerance=0, RhinoVersion="7.38.24338.17001"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})

# ----
# Contextual parameters: Those parameters are only shown after a file is uploaded.
panel = Panel("Rotation Angle")
crv = Curve(curve)
null = NullItem(Item=crv)  # -> NullFlags, InvalidFlags, Description
merge = Merge(Data1=panel, Data2="Floor Height", Data3="Floor Count")
filter = StreamFilter(Gate=null.NullFlags, Stream0=merge)

# ----
# Static paramete: The Floor Plan input (upload button) is always included in the App.
panel_2 = Panel("Floor Plan")

# ----
# Display instructions
# Contextual text: The text widget is only displayed in case no file has been uploaded yet.
panel_3 = Panel("Import a file containing your floor plan to create a twisted tower.")
textwidget = TextWidget(Text=panel_3)

# ----
# Build parameter widgets
# from inputs of the definition
# Parameter widget: The names of sliders, value lists, toggles, ShapeDiver Import components, etc... can be used to build the parameter widget.
merge_2 = Merge(Data1=panel_2, Data2=filter)
paramctrl = ParameterControl(Name=merge_2)
controlswidget = ControlsWidget(Controls=paramctrl)
merge_3 = Merge(Data1=controlswidget, Data2=textwidget)
filter_2 = StreamFilter(Gate=null.NullFlags, Stream0=controlswidget, Stream1=merge_3)

tolerance = ToleranceSettings(AbsoluteTolerance=0.01, RelativeTolerance=1, AngleTolerance=1, UnitSystem=9)

# ----
# Build containers from
# tabs and/or widgets
# Containers: In the default template, four container names can be used: top, left, right and bottom.
# 
# Use widgets directly if your container does not need to be split into tabs.
panel_4 = Panel("left")
buildcontainer = BuildContainer(Name=panel_4, Widgets=filter_2)

# ----
# Build an app
# from containers
app = App(Containers=buildcontainer)

# ==== cluster Cluster
curve = ClusterInput()
num = ClusterInput()
num_2 = ClusterInput()
int = ClusterInput()
curve_2 = Curve(curve)
num_3 = Number(num)
num_4 = Number(num_2)
int_2 = Integer(int)
x_minus_one = XMinusOne(NumberX=int_2)
series = Series(Start=0, Step=num_4, Count=int_2)
division = Division(A=num_3, B=x_minus_one)
series_2 = Series(Start=0, Step=division, Count=int_2)
vec = VectorXYZ(XComponent=0, YComponent=0, ZComponent=series)  # -> Vector, Length
rad = Radians(Degrees=series_2)
move = Move(Geometry=curve_2, Motion=vec.Vector)  # -> Geometry, Transform
rotate = Rotate(Geometry=move.Geometry, Angle=rad, Plane=PlaneXY(0, 0, 0))  # -> Geometry, Transform
vec_2 = VectorXYZ(XComponent=0, YComponent=0, ZComponent=num_4)  # -> Vector, Length
extr = Extrude(Base=rotate.Geometry, Direction=vec_2.Vector)
cap = CapHoles(Brep=extr)
jagged = SettingsSpeed()
mesh = MeshBrep(Brep=cap, Settings=jagged)
multiplication = Multiplication(A=num_4, B=int_2)
item = ListItem(List=mesh, Index=0, Wrap=True)
volume = Volume(Geometry=item)  # -> Volume, Centroid
mesh_2 = Mesh(mesh)
num_5 = Number(multiplication)
mesh_3 = ClusterOutput(mesh_2)
num_6 = Number(volume.Volume)
totalheight = ClusterOutput(num_5)
floorvolume = ClusterOutput(num_6)
