# Grasshopper definition 11G-AccordionAndStackWidgets.ghx (Grasshopper 1.0.7)
# plug-ins: ShapeDiverForGrasshopper

radius = Slider(1, range=0..1)
color = ColourSwatch(SwatchColor=RGB(255, 0, 0))
msphere = MeshSphere(Base=PlaneXY(0, 0, 0), Radius=radius, UCount=10, VCount=20)
gltfdisplay = GlTF20Display(Geometry=msphere, Material=color)

merge = Merge(Data1="Label", Data2="Icon", Data3="Tooltip")
paramctrl = ParameterControl(Name=merge)
controlswidget = ControlsWidget(Controls=paramctrl)
container = Container(Name="left", Widgets=controlswidget)

merge_2 = Merge(Data1="Radius", Data2="Color")
paramctrl_2 = ParameterControl(Name=merge_2)
controlswidget_2 = ControlsWidget(Controls=paramctrl_2)
singleaccordion = SingleAccordionWidget(Label="Accordion", Icon="adjustments-horizontal", Widgets=controlswidget_2)
stack = StackWidget(Label="Stack", Icon="adjustments-horizontal", Widgets=controlswidget_2)
merge_3 = Merge(Data1=singleaccordion, Data2=stack)  # -> flatten(Result)
container_2 = Container(Name="right", Widgets=merge_3)
merge_4 = Merge(Data1=container, Data2=container_2)
app = App(Containers=merge_4)
