# Grasshopper definition BETA-DynamicValueListsTutorial.ghx (Grasshopper 1.0.8)
# plug-ins: jSwan, ShapeDiverForGrasshopper

panel = Panel("""{
  "VegetablesList": "2",
  "FruitsList": "1"
}""")
foodtype = ValueList({"Fruits": 0, "Vegetables": 1, "Meat": 2}, selected="Meat")

# ----
# Get the dynamic parameter values: Add a Direct Text Input component called AppBuilder. This component will send the list of values defined in the App for custom dynamic parameters. This list is sent as a JSON object.
# Example parameter: In this example, we send values for two value lists (VegetablesList and FruitsList).
appbuilder = DirectTextInput(maxlength=10000, text="Default")

int = Integer(foodtype)

parsejson = ParseJSON(JSON=appbuilder)
accessjson = AccessJSON(Object=parsejson, AddressString="FruitsList")
accessjson_2 = AccessJSON(Object=parsejson, AddressString="VegetablesList")
accessjson_3 = AccessJSON(Object=parsejson, AddressString="MeatList")
int_2 = Integer(int)
filter = StreamFilter(Gate=int_2, Stream0=accessjson, Stream1=accessjson_2, Stream2=accessjson_3)
null = NullItem(Item=filter)  # -> NullFlags, InvalidFlags, Description
filter_2 = StreamFilter(Gate=null.NullFlags, Stream0=filter, Stream1=int_2)
int_3 = Integer(filter_2)

int_4 = Integer(int)
txt = Text(["Fruits", "Vegetables", "Meat"])
item = ListItem(List=txt, Index=int_4, Wrap=True)
panel_2 = Panel(txt)
concat = Concatenate(FragmentA=item, FragmentB="List")
txt_2 = Text(concat)

int_5 = Integer(int)
txt_3 = Text(["Bananas", "Strawberries", "Apricots"])
txt_4 = Text(["Broccoli", "Artichokes", "Cucumbers"])
txt_5 = Text(["Chicken", "Beef", "Lamb"])
filter_3 = StreamFilter(Gate=int_5, Stream0=txt_3, Stream1=txt_4, Stream2=txt_5)
txt_6 = Text(filter_3)

txt_7 = Text(txt_2)
txt_8 = Text(txt_6)
int_6 = Integer(int_3)
rejson = SerializeJson(
    Name=txt_7,
    Id=txt_7,
    Type="StringList",
    Visualization="dropdown",
    Choices=txt_8,
    Defval=int_6,
    Value=int_6,
    IncludeNullAndEmptyProperties=False)
txt_9 = Text(rejson)
panel_3 = Panel(txt_9)

txt_10 = Text(txt_2)
paramctrl = ParameterControl(Name="FoodType")
paramctrl_2 = ParameterControl(Name=txt_10, SessionId="default_appbuilder")
merge = Merge(Data1=paramctrl, Data2=paramctrl_2)
controlswidget = ControlsWidget(Controls=merge)
container = Container(Name="right", Widgets=controlswidget)
app = App(Containers=container, Parameters=txt_9)

txt_11 = Text(txt_6)
int_7 = Integer(int_3)
pt = Point(Point(0, 0, 0))
item_2 = ListItem(List=[txt_11, pt], Index=int_7, Wrap=True)
tag = TextTag3D(Location=pt, Text=item_2, Size=1, Justification=7)
