# Grasshopper definition BETA-InstancesTutorial1-Controller.ghx (Grasshopper 1.0.7)
# plug-ins: ShapeDiverForGrasshopper

# ----
# Build the App
panel = Panel("Height")
merge = Merge(Data1="Count", Data2=panel, Data3="Color")
paramctrl = ParameterControl(Name=merge)
controlswidget = ControlsWidget(Controls=paramctrl)
container = Container(Name="right", Widgets=controlswidget)

# ----
# Control the instance's parameter values
# Build parameter values: Use the Parameter Value component to define Name-Value pairs to send to the child instance.
height = Slider(1, range=1..10)
color = ColourSwatch(SwatchColor=RGB(255, 0, 0))
merge_2 = Merge(Data1="Height", Data2="Color")
merge_3 = Merge(Data1=height, Data2=color)
parametervalue = ParameterValue(Name=merge_2, Value=merge_3)

# ----
# Control the number and position of instances
# Duplicate and transform the referenced instance.: In this example, we use a "Count" slider to define the number and position of transformed versions of the referenced instance.
count = Slider(3, range=1..5)
series = Series(Start=0, Step="10", Count=count)
vec = VectorXYZ(XComponent=series, YComponent=0, ZComponent=0)  # -> Vector, Length
move = Move(Motion=vec.Vector)  # -> Geometry, Transform

# ----
# Child instance
# Model used for the child instance: In our example, we reference a simple model creating a box with two sliders and a color swatch.
# 
# In the example below, we create a so-called "Controller" which references an instance of the parametric box model.
# 
# See the simple model online here:
# https://www.shapediver.com/app/m/beta-parametricboxinstance
# Refresh: The gallery sometimes does not initialize images correctly. In that case, double-click on it and press Ok.
gallery = ImageGallery(
    CycleDelay=1,
    Randomize=False,
    UseLocalImages=True,
    UseRemoteImages=True,
    RemoteUrl="https://shapediverdownloads.s3.us-east-1.amazonaws.com/ParametricBox.png")

# ----
# Define the instance: We define a single instance by referencing the slug of the model we want to instantiate.
# 
# Each instance can be assigned a list of Name-Value pairs created with the Parameter Value component, as well as a list of transformations.
# 
# The outputs of the referenced instance will be displayed according to the specified parameter values and can be displayed one or multiple times in the scene according to the input transformation list.
panel_2 = Panel("beta-parametricboxinstance")
instance = DefineInstance(SessionId=panel_2, ParameterValues=parametervalue, Transformations=move.Transform)

app = App(Containers=container, Instances=instance)
