# Grasshopper definition BETA-MultilineTextInput.ghx (Grasshopper 1.0.7)
# plug-ins: ShapeDiverForGrasshopper

multilinetext = DirectTextInput(maxlength=10000, text="Default")
pt = Point(Point(0, 0, 0))
tag = TextTag3D(Location=pt, Text=multilinetext, Size=1, Justification=7)

int = Integer(3)
constructjson = ConstructJSON(Data=int, AddressString="lines")

paramctrl = ParameterControl(Name="MultilineText", Settings=constructjson)
controlswidget = ControlsWidget(Controls=paramctrl)

container = Container(Name="right", Widgets=controlswidget)
app = App(Containers=container)
