# Grasshopper definition BETA-NumberInputWithStep.ghx (Grasshopper 1.0.7)
# plug-ins: ShapeDiverForGrasshopper

num = Number("0.004")
floatwithstep = Slider(1, range=1..10)
constructjson = ConstructJSON(Data=num, AddressString="step")
paramctrl = ParameterControl(Name="FloatWithStep", Settings=constructjson)
msphere = MeshSphere(Base=PlaneXY(0, 0, 0), Radius=floatwithstep, UCount=10, VCount=20)
controlswidget = ControlsWidget(Controls=paramctrl)
container = Container(Name="right", Widgets=controlswidget)
app = App(Containers=container)
