# Grasshopper definition BETA-SearchableValueList.ghx (Grasshopper 1.0.7)
# plug-ins: ShapeDiverForGrasshopper

food = ValueList({"Apples", "Bananas", "Broccoli", "Carrots", "Chocolate", "Cucumbers", "Dates", "Eggplant", "Figs", "Grapes"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}, selected="Jalapenos")
panel = Panel(food)
tag = TextTag3D(Location=PlaneXY(0, 0, 0), Text=panel, Size=1, Justification=7)

bool = Boolean(True)
int = Integer(10)
merge = Merge(Data1=bool, Data2=int)
merge_2 = Merge(Data1="searchable", Data2="limit")
constructjson = ConstructJSON(Data=graft(merge), AddressString=merge_2)

paramctrl = ParameterControl(Name="Food", Settings=constructjson)
controlswidget = ControlsWidget(Controls=paramctrl)

panel_2 = Panel(paramctrl)
container = Container(Name="right", Widgets=controlswidget)
app = App(Containers=container)
