# Grasshopper definition BETA-ValueListWithImages.ghx (Grasshopper 1.0.8)
# plug-ins: ShapeDiverForGrasshopper

type = ValueList({"dropdown", "buttonflex", "buttongroup", "carousel", "chipgroup", "color", "fullwidthcards", "grid", "imagedropdown"}, selected="grid")
panel = Panel("https://shapediverdownloads.s3.us-east-1.amazonaws.com/chocolate.png")
panel_2 = Panel("https://shapediverdownloads.s3.us-east-1.amazonaws.com/broccoli.png")
panel_3 = Panel("https://shapediverdownloads.s3.us-east-1.amazonaws.com/carrot.png")
panel_4 = Panel("https://shapediverdownloads.s3.us-east-1.amazonaws.com/apple.png")
panel_5 = Panel("https://shapediverdownloads.s3.us-east-1.amazonaws.com/banana.png")
merge = Merge(Data1=panel_4, Data2=panel_5, Data3=panel_2, Data4=panel_3, Data5=panel)
merge_2 = Merge(
    Data1="Crisp and refreshing fruit",
    Data2="Naturally sweet and potassium-rich fruit",
    Data3="Nutrient-packed green vegetable",
    Data4="Crunchy and vitamin-rich root vegetable",
    Data5="Indulgent and decadent treat")
txt = Text(["Apples", "Bananas", "Broccoli", "Carrots", "Chocolate"])
panel_6 = Panel(txt)
vlitemdata = ValueListItemData(Name=txt, Description=merge_2, ImageUrl=merge)
valuelistsettings = ValueListSettings(Type=type, ItemData=vlitemdata, N=False)

food = ValueList({"Apples", "Bananas", "Broccoli", "Carrots", "Chocolate"}, selected="Apples")
panel_7 = Panel(food)
tag = TextTag3D(Location=PlaneXY(0, 0, 0), Text=panel_7, Size=1, Justification=7)

paramref = ParameterReference(Name="Food", Settings=valuelistsettings)
merge_3 = Merge(Data1="Type", Data2=paramref)  # -> flatten(Result)
paramwidget = ParameterWidget(ParametersAndExports=merge_3, PreserveOrdering=True)
container = Container(Name="right", Widgets=paramwidget)
app = App(Containers=container)
